# Grasshopper definition VisualizeGeoInRhino.gh (Grasshopper 1.0.7)

panel = Panel("\\166.111.40.8\home\2024_MOOSASIDF_BS2025\test\dataset3\_15.xml")
panel_2 = Panel("\\166.111.40.8\home\2024_MOOSASIDF_BS2025\test\dataset3\_15_out.geo")
path = FilePath(panel)
python = GhPythonScript(fPath=path)  # -> out, idd, cat
# ---------- python: Python ----------
__author__ = "Lenovo"
__version__ = "2025.11.18"

import rhinoscriptsyntax as rs
import xml.etree.ElementTree as ET

def parse_xml_to_face_dict(xml_file):
    """
    解析XML文件，提取model下wall/face/glazing/skylight类型子对象的faceId，
    并返回{faceId: faceType}字典，其中faceType对应编号：glazing=0, face=1, wall=2, skylight=3
    """
    face_type_mapping = {
        'glazing': 0,
        'face': 1,
        'wall': 2,
        'skylight': 3
    }
    result = {}
    

    # 解析XML文件
    tree = ET.parse(xml_file)
    root = tree.getroot()
    
    for tag in face_type_mapping.keys():
        child = root.findall('./'+tag)
        for chi in child:
            fids = chi.find('./faceId')
            for fid in fids.text.split(' '):
                result[fid] = face_type_mapping[tag]

        
    return result
result = parse_xml_to_face_dict(fPath)
idd=list(result.keys())
cat=list(result.values())
# ---------- end python ----------
path_2 = FilePath(panel_2)
file = ReadFile(File=path_2, PerLineParse=True)
swatch = ColourSwatch(SwatchColor=RGB(84, 107, 255))
python_2 = GhPythonScript(lines=file)  # -> out, idd, faces, category, normal; inputs lines: list
# ---------- python_2: Python ----------
__author__ = "Lenovo"
__version__ = "2025.11.03"

import rhinoscriptsyntax as rs
import ghpythonlib.treehelpers as tree

blocks = '\n'.join(lines).split(';\n')
category, idd, normal, faces, holes = [], [], [], [], []
for blk in blocks:
    blk = blk.split('\n')
    coordinates, holeCoordinates = [], {}
    for li in blk:
        li = li.split(',')
        if li[0] == "f":
            cat = li[1]
            idd.append(li[2])
            continue
        if li[0] == "fn":
            try:
                normal.append(li[1:])
            except:
                print('******Warning: FileError, empty face normal.')
                normal.append(None)
        if li[0] == "fv":
            coor = li[1:]
            coordinates.append(coor)
            continue
        if li[0] == "fh":
            if li[1] not in holeCoordinates:
                holeCoordinates[li[1]] = []
            coor = li[2:]
            holeCoordinates[li[1]].append(list(coor))
            continue
    if len(coordinates) > 2:
        category.append(cat)
        fs = [coordinates]
        for coors in holeCoordinates.keys():
            fs.append(holeCoordinates[coors])
        faces.append(fs)


faces =  tree.list_to_tree(faces)
normal = tree.list_to_tree(normal)
idd =  tree.list_to_tree(idd)
# ---------- end python_2 ----------
merge = Merge(
    Data1=swatch,
    Data2=ColourSwatch(SwatchColor=RGB(161, 55, 55)),
    Data3=ColourSwatch(SwatchColor=RGB(255, 196, 87)),
    Data4=swatch,
    Data5=ColourSwatch(SwatchColor=RGB(163, 163, 163)))
txt = Text(python.idd)
txt_2 = Text(python_2.idd)
fsim = FindSimilarMember(Data=txt, Set=txt_2)  # -> Hit, Index
item = ListItem(List=python_2.normal, Index=0, Wrap=True)  # -> Item, Item1, Item2
cluster = Cluster(L=python_2.faces)
area = Area(Geometry=flatten(cluster))  # -> Area, Centroid
merge_2 = Merge(
    Data1=ColourSwatch(SwatchColor=RGB(84, 107, 255)),
    Data2=ColourSwatch(SwatchColor=RGB(255, 196, 87)),
    Data3=ColourSwatch(SwatchColor=RGB(161, 55, 55)))
index = ItemIndex(List=fsim.Hit, Item=txt_2)
vec = VectorXYZ(XComponent=item.Item, YComponent=item.Item1, ZComponent=item.Item2)  # -> Vector, Length
entwine = Entwine(Branch00=python.cat, Branch01="-1", FlattenInputs=True)  # -> flatten(Result)
avr = Average(Input=area.Centroid)
int = Integer(python_2.category)
dprod = DotProduct(VectorA=vec.Vector, VectorB="0,0,1", Unitize=False)
item_2 = ListItem(List=entwine, Index=index, Wrap=True)
rev = Reverse(Vector=avr)
abs = Absolute(Value=dprod)
item_3 = ListItem(List=merge, Index=item_2, Wrap=True)  # -> simplify(graft(Item))
larger = LargerThan(FirstNumber=abs, SecondNumber=0.99)  # -> LargerThan, OrEqualTo
move = Move(Geometry=cluster, Motion=rev)  # -> Geometry, Transform
equals = Equality(FirstNumber=item_2, SecondNumber="-1")  # -> Equality, Inequality
int_2 = Integer(flatten(larger.LargerThan))
expression = Expression(x=int, y=int_2, Expression="y+1-x")
item_4 = ListItem(List=merge_2, Index=expression, Wrap=True)  # -> simplify(graft(Item))
cull = CullPattern(List=int_2, CullPattern=equals.Equality)
cull_2 = CullPattern(List=move.Geometry, CullPattern=larger.LargerThan)
preview = CustomPreview(Geometry=simplify(move.Geometry), Material=item_3)
equals_2 = Equality(FirstNumber=cull, SecondNumber="0")  # -> Equality, Inequality
area_2 = Area(Geometry=cull_2)  # -> flatten(Area), Centroid
ma = MassAddition(Input=equals_2.Equality)  # -> Result, PartialResults
ma_2 = MassAddition(Input=equals_2.Inequality)  # -> Result, PartialResults
panel_3 = Panel(ma.Result)
ma_3 = MassAddition(Input=area_2.Area)  # -> Result, PartialResults
panel_4 = Panel(ma_2.Result)

# ==== cluster Cluster
L = ClusterInput()
item = ListItem(List=L, Index=0, Wrap=True)  # -> Item, Item1, Item2
pt = ConstructPoint(XCoordinate=item.Item, YCoordinate=item.Item1, ZCoordinate=item.Item2)
trim = TrimTree(Tree=pt, Depth=1)
pline = PolyLine(Vertices=trim, Closed=True)
trim_2 = TrimTree(Tree=pline, Depth=1)
boundary = BoundarySurfaces(Edges=trim_2)
S = ClusterOutput(boundary)
